# Dynamo graph ArcoCapaz_secante.dyn (Dynamo 2.13.1.3887)

# group: Construção de Arco Capaz
# Lugar geométrico dos pontos que enxergam um segmento AB sempre com um ângulo determinado.
# Os pontos A e B do segmento não compartilham as propriedades do lugar geométrico (o ângulo de observação se fecha nesses pontos).
angulo = IntegerSlider(90, range=0..90 step 1)
diâmetro = IntegerSlider(1, range=1..10 step 1)
posição_da_secante = DoubleSlider(0.93, range=0..1 step 0.01)
ponto_qualquer_sobre_o_arco = DoubleSlider(0.5, range=0..1 step 0.05)  # "Ponto Qualquer sobre o arco capaz"
define_arco_capaz_com_a_secante = CodeBlock(a=angulo, d=diâmetro, s=posição_da_secante, q=ponto_qualquer_sobre_o_arco)  # "Define arco capaz com a secante de uma circunferência"
# ---------- define_arco_capaz_com_a_secante.designscript (33 lines) ----------
a;
d;
s;

cs  = CoordinateSystem.Identity();
x   = [0 , d , 0];
y   = [0 , 0 , 0];
z   = [0 , 0 , 0];
VX  = Vector.XAxis( );
VZ  = Vector.ZAxis( );
//------------------------------------------------------------
//Diametro inicial
//------------------------------------------------------------
PO  = Point.ByCoordinates         (  x     ,  y   ,  z );
DI  = Line.ByStartPointEndPoint   ( PO[0]  , PO[1]     );
PM  = Line.PointAtParameter       ( DI     , 0.5       );
CI  = Circle.ByCenterPointRadius  ( PM     ,    d/2    );

SEC = Line.Translate              ( DI , 0 , s*d/2 , 0 );
AB  = Geometry.Intersect          ( CI , SEC           );

VC  = Vector.ByTwoPoints          ( PM      , AB       );
AN  = Vector.AngleWithVector      ( VC[1]   , VC[0]    );
LI  = Line.ByStartPointEndPoint   ( PM      , AB       );

PQ  = Arc.PointAtParameter        ( AC      ,        q );

VT1 = Vector.Rotate               ( VX    , VZ  , a      );
AC  = Arc.ByStartPointEndPointStartTangent( AB[0] , AB[1] , VT1);

VV  = Vector.ByTwoPoints          ( PQ    , AB          );
LV  = Line.ByStartPointEndPoint   ( PQ    , AB          );
AV  = Vector.AngleWithVector      ( VV[1] , VV[0]       );
# ----------------------------------------
verificação_do_ângulo_de_visão = Watch(define_arco_capaz_com_a_secante.AV)
