# Dynamo custom node Homologia_01.dyf (Dynamo 2.3.0.5885)
# category: Sistemas_Projetivos
# Se uma reta pertence a um plano os traços da reta são pontos que pertencem aos traços do plano

Angulo = Input(Angulo: var[]..[])
Quantidade_de_Retas = Input(Quantidade_de_Retas: var[]..[])
Plano = Input(Plano: var[]..[])
Diedro = Input(Diedro: var[]..[])
homologia_01 = CodeBlock(angulo=Angulo, Qr=Quantidade_de_Retas, Plano=Plano, Diedro=Diedro)
# ---------- homologia_01.designscript (47 lines) ----------
angulo;
Qr;
Plano;
Diedro;
LTE = Diedro["LTerra"];
PPR = Diedro["Diedro"];
PTS = Plano["Pontos"];
TRA = Plano["Traços"];
FIG = Plano["Figura"];
SUP = Plano["Superficie"];
RAI = Plano["Raios"];
CON = Plano["Contorno"];
PTR  = List.Flatten(Plano["PtProjetado"], 3);
PRO  = List.Flatten(Plano["Projeções"]  , 3);
CHA  = List.Flatten(Plano["Chamadas"]   , 3);
TRAH = List.Flatten( TRA , 1)[0];
TRAV = List.Flatten( TRA , 1)[1];

orig   = Point.ByCoordinates ( 0 , 0 , 0 );
eixo   = Vector.XAxis();
dirh   = Vector.ZAxis().Reverse();
dirv   = Vector.YAxis();

Lifig  = Surface.PerimeterCurves   ( SUP);
Ptfig  = Line.PointAtParameter     ( Lifig<1> , 0..1..(1/Qr));
LiPla  = Line.ByStartPointEndPoint ( Ptfig    , List.ShiftIndices (Ptfig , 1));

HoPOH  = [ Line.Intersect(TRAH<1>, Curve.ExtendStart ( LiPla , 1000)) ,
           Line.Intersect(TRAH<1>, Curve.ExtendEnd   ( LiPla , 1000)) ];
HoPOV  = [ Line.Intersect(TRAV<1>, Curve.ExtendStart ( LiPla , 1000)) ,
           Line.Intersect(TRAV<1>, Curve.ExtendEnd   ( LiPla , 1000)) ];

HoLIH  = [ Line.ByStartPointEndPoint ( HoPOH[0] ,   LiPla.StartPoint ),
           Line.ByStartPointEndPoint ( HoPOH[1] ,   LiPla.EndPoint   ) ];
HoLIV  = [ Line.ByStartPointEndPoint ( HoPOV[0] ,   LiPla.StartPoint ),
           Line.ByStartPointEndPoint ( HoPOV[1] ,   LiPla.EndPoint   ) ];

ProHP   = Point.Project ( HoPOH , PPR<1>, dirh );
ProHL   = Line.Project  ( HoLIH , PPR<1>, dirh );
ProHLi  = Line.Project  ( LiPla , PPR<1>, dirh );
ProVP   = Point.Project ( HoPOV , PPR<1>, dirv );
ProVL   = Line.Project  ( HoLIV , PPR<1>, dirv );

Epura3D = List.Flatten( [ProHP, ProHL, ProVP , ProVL, ProHLi ] , 10);
Epura2D = Epura3D!=null?Geometry.Rotate( Epura3D , orig, eixo, angulo):null;

[ProHLi, HoPOH, HoPOV, HoLIH, HoLIV, Ptfig, LiPla, Epura2D, Epura3D];
# ----------------------------------------
Resultado = Output(homologia_01.out35)
