# Dynamo custom node Homologias_Com_Eixo.dyf (Dynamo 2.3.0.5885)
# category: Sistemas_Projetivos
# Constroi Homologia com Eixo

Ajusta_Eixo = Input(Ajusta_Eixo: var[]..[])
Desloca_Vértice = Input(Desloca_Vértice: var[]..[])
Ajusta_Ponto_B = Input(Ajusta_Ponto_B: var[]..[])
Ajusta_Ponto_S_no_Eixo = Input(Ajusta_Ponto_S_no_Eixo: var[]..[])
Desloca_Ponto_A = Input(Desloca_Ponto_A: var[]..[])
Homologia_Afim = Input(Homologia_Afim: var[]..[])
Rebatimentos = Input(Rebatimentos: var[]..[])
Simetrias_Axiais = Input(Simetrias_Axiais: var[]..[])
construção_das_homologias_com = CodeBlock(TE=Ajusta_Eixo, DV=Desloca_Vértice, i=Ajusta_Ponto_B, j=Ajusta_Ponto_S_no_Eixo, m=Desloca_Ponto_A, afim=Homologia_Afim, reba=Rebatimentos, sime=Simetrias_Axiais)  # "Construção das Homologias com Eixo Próprio e Vértice Próprio e Impróprio."
# ---------- construção_das_homologias_com.designscript (45 lines) ----------
TE;
DV;
i;
j;
m;
afim;
reba;
sime;

PR      = Point.ByCoordinates             ( -TE ,  0 , 0   );
PS      = Line.PointAtParameter           ( Eix ,  j       );
PT      = Point.ByCoordinates             ( TE  ,  0 , 0   );
Eix     = Line.ByStartPointEndPoint       ( PR  , PT       );
Ver     = Point.ByCoordinates             (  0  , DV , 0   );
V1      = Vector.ByCoordinates            (  5  , m  , 0   );
r1      = Line.ByStartPointDirectionLength( PR  , V1 , TE/2);
r2      = Line.ByStartPointEndPoint       ( PT  , PA       );
r3      = Line.ByStartPointEndPoint       ( PS  , PA       );
r4      = Line.ByStartPointEndPoint       ( PT  , PB       );
PA      = Line.PointAtParameter           ( r1  , 1        );
PB      = Line.PointAtParameter           ( r1  , i        );
PC      = List.Flatten ( Line.Intersect   ( r3  , r4)  ,  1)[0];

proprio = Line.ByStartPointEndPoint       ( PA  , Ver      );
direcao = proprio.Direction;
ortogon = Vector.YAxis     ( );
dista   = Point.DistanceTo ( pABC , Point.Project ( pABC , Eix, ortogon ))*2;

rVABC   = (afim && sime) ? Line.ByStartPointDirectionLength (pABC, ortogon , dista ):
          (afim && reba) ? Line.ByStartPointDirectionLength (pABC, ortogon , DV    ):
           afim          ? Line.ByStartPointDirectionLength (pABC, direcao , DV    ):
                           Line.ByStartPointEndPoint        (pABC, Ver );

pABC  =              [PA , PB , PC ];
pABCh = List.Flatten([PHa, PHb, PHc] , 1);

PHa   = Line.PointAtParameter         ( rVABC[0] , sime ? 1:0.3);
PHb   = List.Flatten ( Line.Intersect ( rVABC[1] , Hl1 ) , 1)[0];
PHc   = List.Flatten ( Line.Intersect ( rVABC[2] , Hl3 ) , 1)[0];
Hl1   = Line.ByStartPointEndPoint     ( PR  , PHa  );
Hl2   = Line.ByStartPointEndPoint     ( PS  , PHa  );
Hl3   = Line.ByStartPointEndPoint     ( PT  , PHb  );

Homologas = Surface.ByPerimeterPoints ( [pABC , pABCh] );
[Eix, Ver ,PR,PS,PT, pABC, pABCh , rVABC, Homologas, [r1,r2,r3,r4] , [PHa, PHb, PHc] , [Hl1, Hl2, Hl3]];
# ----------------------------------------
Resultado_Homologia = Output(construção_das_homologias_com.out35)
