# Dynamo custom node Homologias_Sem_Eixo.dyf "Homologia_Eixo_Improprio" (Dynamo 2.3.0.5885)
# category: Sistemas_Projetivos
# Constroi Homotetias e Translações

Desloca_Vértice_da_Homologia = Input(Desloca_Vértice_da_Homologia: var[]..[])
Desloca_Ponto_A = Input(Desloca_Ponto_A: var[]..[])
Desloca_Ponto_B = Input(Desloca_Ponto_B: var[]..[])
Desloca_Ponto_C = Input(Desloca_Ponto_C: var[]..[])
Fator_Escalar = Input(Fator_Escalar: var[]..[])
Homotetia_Inversa = Input(Homotetia_Inversa: var[]..[])
Translação = Input(Translação: var[]..[])
# note: Homologias de Eixo Impróprio
# e Vértice Próprio e Impróprio
# Homotetia Direta e Inversa
# Translações
construção_das_homologias_com = CodeBlock(V=Desloca_Vértice_da_Homologia, a=Desloca_Ponto_A, b=Desloca_Ponto_B, c=Desloca_Ponto_C, i=Fator_Escalar, inv=Homotetia_Inversa, tra=Translação)  # "Construção das Homologias com Eixo Impróprio e Vértice Próprio e Impróprio."
# ---------- construção_das_homologias_com.designscript (25 lines) ----------
V;
a;
b;
c;
i;
inv;
tra;
x     = [-10, 10,  20];
y     = [-10,  5, -10];
dx    = [  a,  b,   c];
dy    = [  a,  b,   c];
xv    = V;
yv    = V;

verti = tra ? Point.ByCoordinates ( x+dx+xv , y+dy+yv , 0 ):
              Point.ByCoordinates ( xv      , yv      , 0 );

pABC  = Point.ByCoordinates       ( x+dx    , y+dy    , 0 );
raios = Line.ByStartPointEndPoint ( verti   , pABC        );
pABCh = tra ? pABC : Line.PointAtParameter( raios  , inv? -(1-i) : 1-i);
rABCi = inv&&tra==false ? Line.ByStartPointEndPoint(verti , pABCh):null;
fABC  = Surface.ByPerimeterPoints ( pABC  );
fABCh = Surface.ByPerimeterPoints ( tra ? verti : pABCh );

[verti, pABC, raios, pABCh, rABCi, fABC, fABCh];
# ----------------------------------------
Resultado_da_Homologia = Output(construção_das_homologias_com.out20)
