# Dynamo graph SP_Estudo_Plano.dyn (Dynamo 2.3.0.5885)
# packages: Sistemas_Projetivos 1.0.0

SP_Rotaciona_PPH_Plano = Custom[SP_Rotaciona_PPH_Plano]()  # package Sistemas_Projetivos; Rotaciona o PPH do traçado; unwired: Angulo, Plano, Diedro
code_block = CodeBlock(Traçado=SP_Rotaciona_PPH_Plano)
# ---------- code_block.designscript (10 lines) ----------
Traçado;
L1 = Line.ByStartPointEndPoint(Traçado[9][0], Traçado[9][2]);
L2 = Line.ByStartPointEndPoint(Traçado[9][2], Traçado[9][4]);
L3 = Line.ByStartPointEndPoint(Traçado[9][4], Traçado[9][0]);
TraH = Traçado[4][0];
TraV = Traçado[4][1];
d1   = L1.Direction.Reverse();
d2   = L2.Direction.Reverse();
d3   = L3.Direction.Reverse();
PL1  = Line.Project(TraH<1> , [L1 ,L2 ,L3] , [ d1 , d2 , d3]);
# ----------------------------------------
watch = Watch(code_block.TraH)  # graph output
rota_plano_de_projeção = DoubleSlider(0, range=0..90 step 10)  # "Rota Plano de Projeção Horizontal"; graph input
tamanho_construção = DoubleSlider(16, range=1..25 step 1)  # graph input
deslocar = DoubleSlider(70, range=1..100 step 1)  # graph input
SP_Sistema_Diedrico = Custom[SP_Sistema_Diedrico](Escala=tamanho_construção, Deslocar=deslocar)  # package Sistemas_Projetivos; Cria os planos de projeção
abscissa = DoubleSlider(0, range=0..5 step 0.1)  # graph input
afastamento = DoubleSlider(1.2, range=0..5 step 0.1)  # graph input
cota = DoubleSlider(2, range=0..5 step 0.1)  # graph input
SP_Locar_Ponto = Custom[SP_Locar_Ponto](Diedro=SP_Sistema_Diedrico, abscissa=abscissa, Afastamento=afastamento, Cota=cota)  # package Sistemas_Projetivos; Localiza um ponto em Sistema Diedrico
abscissa_2 = DoubleSlider(1.1, range=0..5 step 0.1)  # graph input
afastamento_2 = DoubleSlider(5, range=0..5 step 0.1)  # graph input
cota_2 = DoubleSlider(2, range=0..5 step 0.1)  # graph input
SP_Locar_Ponto_2 = Custom[SP_Locar_Ponto](Diedro=SP_Sistema_Diedrico, abscissa=abscissa_2, Afastamento=afastamento_2, Cota=cota_2)
abscissa_3 = DoubleSlider(5, range=0..5 step 0.1)  # graph input
afastamento_3 = DoubleSlider(3.1, range=0..5 step 0.1)  # graph input
cota_3 = DoubleSlider(5, range=0..5 step 0.1)  # graph input
SP_Locar_Ponto_3 = Custom[SP_Locar_Ponto](Diedro=SP_Sistema_Diedrico, abscissa=abscissa_3, Afastamento=afastamento_3, Cota=cota_3)
SP_Locar_Plano = Custom[SP_Locar_Plano](P1=SP_Locar_Ponto.Ponto, P2=SP_Locar_Ponto_2.Ponto, P3=SP_Locar_Ponto_3.Ponto, Diedro=SP_Locar_Ponto_3.Diedro)  # package Sistemas_Projetivos; Posiciona um plano a partir de 3 pontos
qretas = DoubleSlider(24, range=1..25 step 1)  # graph input
teorema_dos_traços_homologia = CodeBlock(angulo=rota_plano_de_projeção, Diedro=SP_Locar_Plano.Diedro, Qr=qretas, Plano=SP_Locar_Plano.Plano)
# ---------- teorema_dos_traços_homologia.designscript (40 lines) ----------
angulo;
Prolon= 1000;
Diedro;
Qr;
LTE = Diedro["LTerra"];
PPR = Diedro["Diedro"];
PTS = Plano["Pontos"];
TRA = Plano["Traços"];
FIG = Plano["Figura"];
SUP = Plano["Superficie"];
RAI = Plano["Raios"];
CON = Plano["Contorno"];

PTR = List.Flatten(Plano["PtProjetado"], 3);
PRO = List.Flatten(Plano["Projeções"]  , 3);
CHA = List.Flatten(Plano["Chamadas"]   , 3);
TRAH = List.Flatten(TRA, 1)[0];
TRAV = List.Flatten(TRA, 1)[1];

Lins = [
        Line.ByStartPointEndPoint(PTS[0], PTS[1]),
        Line.ByStartPointEndPoint(PTS[1], PTS[2]),
        Line.ByStartPointEndPoint(PTS[2], PTS[0])
      ];

div1 = Line.PointAtParameter(Lins<1>, 0..1..(1/Qr));
ldiv = Line.ByStartPointEndPoint(div1, List.ShiftIndices(div1, 1));
HoPtH =
List.Flatten([
  Line.ByStartPointEndPoint ( Line.Intersect(TRAH, Curve.ExtendStart(ldiv, Prolon)) ,ldiv.StartPoint ),
  Line.ByStartPointEndPoint ( Line.Intersect(TRAH, Curve.ExtendEnd  (ldiv, Prolon)) ,ldiv.EndPoint   ),
  Line.ByStartPointEndPoint ( Line.Intersect(TRAH, Curve.ExtendStart(Lins, Prolon)) ,ldiv.StartPoint ),
  Line.ByStartPointEndPoint ( Line.Intersect(TRAH, Curve.ExtendEnd  (Lins, Prolon)) ,ldiv.EndPoint   )
] , 2);
HoPtV = List.Flatten([
  Line.ByStartPointEndPoint ( Line.Intersect(TRAV, Curve.ExtendStart(ldiv, Prolon)) ,ldiv.StartPoint ),
  Line.ByStartPointEndPoint ( Line.Intersect(TRAV, Curve.ExtendEnd  (ldiv, Prolon)) ,ldiv.EndPoint   ),
  Line.ByStartPointEndPoint ( Line.Intersect(TRAV, Curve.ExtendStart(Lins, Prolon)) ,ldiv.StartPoint ),
  Line.ByStartPointEndPoint ( Line.Intersect(TRAV, Curve.ExtendEnd  (Lins, Prolon)) ,ldiv.EndPoint   )
] , 2);
# ----------------------------------------
watch_2 = Watch(teorema_dos_traços_homologia.div1)
watch_3 = Watch()  # unwired: arg0
watch_4 = Watch(teorema_dos_traços_homologia.HoPtH)
watch_5 = Watch()  # unwired: arg0
