# Dynamo graph SP_Estudo_Ponto.dyn (Dynamo 2.3.0.5885)

SP_Sistema_Diedrico = Custom[SP_Sistema_Diedrico]()  # Cria os planos de projeção

# group: Ponto
abscissa = DoubleSlider(3, range=0..5 step 0.1)
afastamento = DoubleSlider(-2.9, range=-5..5 step 0.1)
cota = DoubleSlider(-0.4, range=-5..5 step 0.1)
SP_Locar_Ponto = Custom[SP_Locar_Ponto](Planos_de_Projeção=SP_Sistema_Diedrico, abscissa=abscissa, Afastamento=afastamento, Cota=cota)  # Localiza um ponto em Sistema Diedrico

rota_plano_de_projeção = DoubleSlider(90, range=0..90 step 10)  # "Rota Plano de Projeção Horizontal"
rotacionar_plano_horizontal_para = CodeBlock(Ponto1=SP_Locar_Ponto, angulo=rota_plano_de_projeção)  # "Rotacionar plano Horizontal para formar a Epura Plana"
# ---------- rotacionar_plano_horizontal_para.designscript (20 lines) ----------
Ponto1;
Ponto1["LTerra"    ];
Ponto1["Ponto"     ];
Ponto1["RaiosProj" ];
//Ponto1["Bisetor13" ];
//Ponto1["Bisetor24" ];
//Elementos q rotacionam ------------------
PlanosPr = Ponto1["Planos"    ];
Chamadas = Ponto1["Chamadas"  ];
PontoPro = Ponto1["PontosProj"];
angulo;
//Constantes--------------------------------
orig   = Point.ByCoordinates ( 0 , 0 , 0 );
eixo   = Vector.XAxis();
//------------------------------------------
Epura3D = [ PontoPro[0] , Chamadas[0] ];
PlaPH3D =   PlanosPr[0];

PHP2D   = PlaPH3D!=null?Geometry.Rotate( PlaPH3D , orig, eixo, angulo):null;
Epu2D   = Epura3D!=null?Geometry.Rotate( Epura3D , orig, eixo, angulo):null;
# ----------------------------------------
