# Dynamo graph SP_Estudo_Reta.dyn (Dynamo 2.3.0.5885)

SP_Sistema_Diedrico = Custom[SP_Sistema_Diedrico]()  # Cria os planos de projeção

# group: Reta a
abscissa = DoubleSlider(4.9, range=0..5 step 0.1)
afastamento = DoubleSlider(3.4, range=0..5 step 0.1)
cota = DoubleSlider(1.9, range=0..5 step 0.1)
SP_Locar_Ponto = Custom[SP_Locar_Ponto](Planos_de_Projeção=SP_Sistema_Diedrico, abscissa=abscissa, Afastamento=afastamento, Cota=cota)  # Localiza um ponto em Sistema Diedrico
abscissa_2 = DoubleSlider(0.9, range=0..5 step 0.1)
afastamento_2 = DoubleSlider(3.4, range=0..5 step 0.1)
cota_2 = DoubleSlider(0.5, range=0..5 step 0.1)
SP_Locar_Ponto_2 = Custom[SP_Locar_Ponto](Planos_de_Projeção=SP_Sistema_Diedrico, abscissa=abscissa_2, Afastamento=afastamento_2, Cota=cota_2)
SP_Locar_Reta = Custom[SP_Locar_Reta](Ponto_1=SP_Locar_Ponto, Ponto_2=SP_Locar_Ponto_2)  # Projeta reta

rota_plano_de_projeção = DoubleSlider(0, range=0..90 step 10)  # "Rota Plano de Projeção Horizontal"
SP_Rotaciona_PPH = Custom[SP_Rotaciona_PPH](Reta=SP_Locar_Reta, Angulo=rota_plano_de_projeção)  # Rotaciona o plano de projeção Horizontal para formar a Epura 2D

# group: Reta a
abscissa_3 = DoubleSlider(2.6, range=0..5 step 0.1)
afastamento_3 = DoubleSlider(3.4, range=0..5 step 0.1)
cota_3 = DoubleSlider(2.1, range=0..5 step 0.1)
SP_Locar_Ponto_3 = Custom[SP_Locar_Ponto](Planos_de_Projeção=SP_Sistema_Diedrico, abscissa=abscissa_3, Afastamento=afastamento_3, Cota=cota_3)
abscissa_4 = DoubleSlider(0.9, range=0..5 step 0.1)
afastamento_4 = DoubleSlider(0.7, range=0..5 step 0.1)
cota_4 = DoubleSlider(1.5, range=0..5 step 0.1)
SP_Locar_Ponto_4 = Custom[SP_Locar_Ponto](Planos_de_Projeção=SP_Sistema_Diedrico, abscissa=abscissa_4, Afastamento=afastamento_4, Cota=cota_4)
SP_Locar_Reta_2 = Custom[SP_Locar_Reta](Ponto_1=SP_Locar_Ponto_3, Ponto_2=SP_Locar_Ponto_4)

SP_Rotaciona_PPH_2 = Custom[SP_Rotaciona_PPH](Reta=SP_Locar_Reta_2, Angulo=rota_plano_de_projeção)
