# Dynamo graph SP_Homologias.dyn (Dynamo 2.3.0.5885)

ajusta_eixo_da_homologia = DoubleSlider(28.7, range=0..100 step 0.1)
desloca_vértice_da_homologia = DoubleSlider(51.4, range=0..100 step 0.1)
ajuste_ponto_b = DoubleSlider(0.65, range=0..1 step 0.05)
ajuste_ponto_s_sobre_eixo = DoubleSlider(0.75, range=0.25..0.85 step 0.25)
desloca_ponto_a = DoubleSlider(-4, range=-4..-1 step 0.25)
homologia_afim = BoolSelector(false)
rebatimento = BoolSelector(true)
simetria_axial = BoolSelector(true)
construção_das_homologias = CodeBlock(TE=ajusta_eixo_da_homologia, DV=desloca_vértice_da_homologia, i=ajuste_ponto_b, j=ajuste_ponto_s_sobre_eixo, m=desloca_ponto_a, afim=homologia_afim, reba=rebatimento, simetria=simetria_axial)
# ---------- construção_das_homologias.designscript (40 lines) ----------
TE;
DV;
i;
j;
m;
afim;
reba;
PR  = Point.ByCoordinates           ( -TE   ,  0   , 0 );
PS  = Line.PointAtParameter         ( Eix   , j        );
PT  = Point.ByCoordinates           (  TE   ,  0   , 0 );
Eix = Line.ByStartPointEndPoint     ( PR    , PT       );
Ver = afim?null:Point.ByCoordinates (  0    , DV   , 0 );
V1  = Vector.ByCoordinates          (  5    , m    , 0 );

r1  = Line.ByStartPointDirectionLength (PR , V1 , TE/2 );
r2  = Line.ByStartPointEndPoint        (PT , PA        );
r3  = Line.ByStartPointEndPoint        (PS , PA        );
r4  = Line.ByStartPointEndPoint        (PT , PB        );

PA  = Line.PointAtParameter        ( r1 , 1 );
PB  = Line.PointAtParameter        ( r1 , i );
PC  = List.Flatten( Line.Intersect ( r3 , r4) , 1)[0];

dirafim = reba?
           Vector.YAxis():
           Line.ByStartPointEndPoint(PA, Point.ByCoordinates( 0, DV, 0)).Direction;

pABC  = [PA , PB , PC ];
pABCh = [PHa, PHb, PHc];
rVABC = afim? Line.ByStartPointDirectionLength( pABC  ,  dirafim , simetria?-2*m:DV ):
              Line.ByStartPointEndPoint       ( pABC  ,  Ver );

PHa   = Line.PointAtParameter        ( rVABC[0] , 0.6 );
PHb   = List.Flatten (Line.Intersect ( rVABC[1] , Hl1 ) , 1)[0];
PHc   = List.Flatten (Line.Intersect ( rVABC[2] , Hl3 ) , 1)[0];
Hl1   = Line.ByStartPointEndPoint    ( PR , PHa );
Hl2   = Line.ByStartPointEndPoint    ( PS , PHa );
Hl3   = Line.ByStartPointEndPoint    ( PT , PHb );

Homologas = Surface.ByPerimeterPoints  ( [pABC , pABCh] );
# ----------------------------------------
watch = Watch(construção_das_homologias.PC)
