# Dynamo graph SP_Homologias_Eixo_Improprio.dyn (Dynamo 2.3.0.5885)

desloca_vértice_da_homologia = DoubleSlider(50, range=0..50 step 0.1)
desloca_ponto_a = DoubleSlider(3, range=0..10 step 0.25)
ajuste_ponto_b = DoubleSlider(1.75, range=0..10 step 0.05)
ajuste_ponto_c = DoubleSlider(2.85, range=0..10 step 0.05)
i = DoubleSlider(0.75, range=0..1 step 0.05)
homotetia_inversa = BoolSelector(false)
translação = BoolSelector(true)
# note: Homologias de Eixo Impróprio
# e Vértice Próprio e Impróprio
# Homotetia Direta e Inversa
# Translações
homologia_Eixo_Improprio = Custom[Homologia_Eixo_Improprio](Desloca_Vértice_da_Homologia=desloca_vértice_da_homologia, Desloca_Ponto_A=desloca_ponto_a, Desloca_Ponto_B=ajuste_ponto_b, Desloca_Ponto_C=ajuste_ponto_c, Fator_Escalar=i, Homotetia_Inversa=homotetia_inversa, Translação=translação)  # Constroi Homotetias e Translações
