# Dynamo graph SP_Homologias_Eixo_Proprio.dyn (Dynamo 2.3.0.5885)

ajusta_eixo_da_homologia = DoubleSlider(11.1, range=0..100 step 0.1)
desloca_vértice_da_homologia = DoubleSlider(-49.5, range=-100..100 step 0.1)
ajuste_ponto_b = DoubleSlider(0.4, range=0..1 step 0.05)
ajuste_ponto_s_sobre_eixo = DoubleSlider(0.4, range=0.25..0.85 step 0.05)
desloca_ponto_a = DoubleSlider(-5, range=-10..-1 step 0.25)
homologia_afim = BoolSelector(false)
rebatimento = BoolSelector(false)
simetria_axial = BoolSelector(false)
# note: Homologias:
# Transformações geométricas por correspondências Homológicas são um capítulo importante para o desenvolvimento de Seções Planas, Rebatimentos e Simetrias.
# Homologia Afim : Vértice Impróprio
# Rebatimentos: Homologia Afim com direção da Homologia perpendicular ao eixo
# Simetria Axial:  Homologia Afim Ortogonal ao Eixo e Distancias iguas dos pontos correspondentes
homologias_de_Eixo_Próprio = Custom[Homologias_de_Eixo_Próprio](Ajusta_Eixo=ajusta_eixo_da_homologia, Desloca_Vértice=desloca_vértice_da_homologia, Ajusta_Ponto_B=ajuste_ponto_b, Ajusta_Ponto_S_no_Eixo=ajuste_ponto_s_sobre_eixo, Desloca_Ponto_A=desloca_ponto_a, Homologia_Afim=homologia_afim, Rebatimentos=rebatimento, Simetrias_Axiais=simetria_axial)  # Constroi Homologia com Eixo
