# Dynamo custom node SP_Locar_Plano.dyf (Dynamo 2.3.0.5885)
# category: Sistemas_Projetivos
# Posiciona um plano a partir de 3 pontos

Diedro = Input(Diedro: var[]..[])  # Lista com os 4 semiplanos de projeção
P1 = Input(P1: var[]..[])  # Se refere a um ponto utilizando as função SP_Locar_Ponto
P2 = Input(P2: var[]..[])  # Se refere a um ponto utilizando as função SP_Locar_Ponto
P3 = Input(P3: var[]..[])  # Se refere a um ponto utilizando as função SP_Locar_Ponto
code_block = CodeBlock(Diedro=Diedro, p1=P1, p2=P2, p3=P3)
# ---------- code_block.designscript (46 lines) ----------
Diedro;
LTE = Diedro["LTerra"   ];
PPR = Diedro["Diedro"   ];

pt1 = p1["Ponto"];
pt2 = p2["Ponto"];
pt3 = p3["Ponto"];
pr1 = p1["PontosProj"];
pr2 = p2["PontosProj"];
pr3 = p3["PontosProj"];
ra1 = p1["RaiosProj"];
ra2 = p2["RaiosProj"];
ra3 = p3["RaiosProj"];
ch1 = p1["Chamadas"];
ch2 = p2["Chamadas"];
ch3 = p3["Chamadas"];

Vz      = Vector.ZAxis();
Vy      = Vector.YAxis();
L3P     = [pt1 , pt2 , pt3];
LUP     = List.UniqueItems ( L3P );
EsPlano = List.Count(LUP) == 3? true:false;
EsReta  = List.Count(LUP) == 2? true:false;
EsPonto = List.Count(LUP) == 1? true:false;

FigPla = EsPlano ? Plane.ByThreePoints       (LUP[0]   , LUP[1]   , LUP[2]  ):
         EsReta  ? Line.ByStartPointEndPoint (LUP[0]   , LUP[1]             ):
                   Point.ByCoordinates       (LUP[0].X , LUP[0].Y , LUP[0].Z);

Polig  = PolyCurve.ByPoints  ( L3P      , true              );
Super  = Surface.ByPatch     ( Polig                        );
proHV  = PolyCurve.Project   ( Polig    , PPR<1> , [Vz, Vy] );
Tracos = Plane.Intersect     ( PPR      , FigPla            );
Infin  = Surface.BySweep     ( Tracos[0][1], Tracos[1][0]   );

ke     = ["Pontos"       , "Raios"        ,  "Chamadas"     ,
          "PtProjetado"  , "Contorno"     ,  "Superficie"   ,
          "Projeções"    , "Figura"       ,  "Traços"       , "PlanoInfinito"];
va     = [ L3P            , [ra1, ra2, ra3], [ch1, ch2, ch3],
           [pr1, pr2, pr3], Polig          , Super          ,
           proHV          , FigPla         , Tracos         , Infin];

Dic     = Dictionary.ByKeysValues(ke, va);
Diedro;
[LTE, PPR, pt1, pt2, pt3, pr1, pr2, pr3, ra1, ra2, ra3, ch1, ch2, ch3, FigPla,
Polig, Super, proHV, Tracos,Infin];
# ----------------------------------------
Plano = Output(code_block.out30)
Diedro_2 = Output(code_block.out31)  # "Diedro"
ElementosGeometricos = Output(code_block.out32)
