# Dynamo custom node SP_Locar_Ponto.dyf (Dynamo 2.3.0.5885)
# category: Sistemas_Projetivos
# Localiza um ponto em Sistema Diedrico

Planos_de_Projeção = Input(Planos_de_Projeção: var[]..[])  # Lista com os 4 semiplanos de projeção
abscissa = Input(abscissa: var[]..[])
Afastamento = Input(Afastamento: var[]..[])
Cota = Input(Cota: var[]..[])
code_block = CodeBlock(Planos=Planos_de_Projeção, i1=abscissa, j1=Afastamento, k1=Cota)
# ---------- code_block.designscript (48 lines) ----------
d = 20;
Planos;
plH   =  [Planos[0], Planos[1]];
plV   =  [Planos[2], Planos[3]];
Bis13 =  [
           Point.ByCoordinates (0   ,  100 ,  100) ,
           Point.ByCoordinates (100 ,  100 ,  100) ,
           Point.ByCoordinates (100 , -100 , -100) ,
           Point.ByCoordinates (0   , -100 , -100)
         ];
Bis24 =  [
           Point.ByCoordinates (0   ,  100 , -100) ,
           Point.ByCoordinates (100 ,  100 , -100) ,
           Point.ByCoordinates (100 , -100 ,  100) ,
           Point.ByCoordinates (0   , -100 ,  100)
         ];
//---------------------------------------------------
// Linha de terra
//---------------------------------------------------
Lterra = Geometry.Intersect ( plH , plV );
x1     =  i1*d;
y1     = -j1*d;
z1     =  k1*d;

dirH   = z1 > 0 ? Vector.ZAxis ().Reverse() : Vector.ZAxis();
dirV   = y1 > 0 ? Vector.YAxis ().Reverse() : Vector.YAxis();

ponto  = Point.ByCoordinates ( x1 , y1  , z1      );
projh  = Point.Project       ( ponto<1> , plH , dirH );
projv  = Point.Project       ( ponto<1> , plV , dirV );

Rproj  = Line.ByStartPointEndPoint( ponto<1>, [projh,projv]);
Cha1   = Geometry.Translate       ( Rproj[1] , dirH ,  z1<0?-z1:z1);
Cha2   = Geometry.Translate       ( Rproj[0] , dirV ,  y1<0?-y1:y1);

Bisetor13 = Surface.ByPerimeterPoints ( Bis13 );
Bisetor24 = Surface.ByPerimeterPoints ( Bis24 );

Ke    = [ "Planos"    , "Ponto"      ,
          "LTerra"    , "PontosProj" ,
          "RaiosProj" , "Chamadas"   ,
          "Bisetor13" , "Bisetor24"    ];

Va    = [ [plH, plV]  ,   ponto       ,
           Lterra     , [projh,projv] ,
           Rproj      , [Cha1,Cha2]   ,
           Bisetor13  ,  Bisetor24     ];
Ponto = Dictionary.ByKeysValues(Ke, Va);
# ----------------------------------------
Ponto = Output(code_block.Ponto)
