# Dynamo custom node SP_Locar_Reta.dyf (Dynamo 2.3.0.5885)
# category: Sistemas_Projetivos
# Projeta reta

Diedro = Input(Diedro: var[]..[])  # Se refere ao Sistema Diédrico criado pela função SP_Sistema_Diedrico
Ponto_1 = Input(Ponto_1: var[]..[])  # Se refere a um ponto criado pela função SP_Locar_Ponto
Ponto_2 = Input(Ponto_2: var[]..[])  # Se refere a um ponto criado pela função SP_Locar_Ponto
code_block = CodeBlock(Diedro=Diedro, Ponto1=Ponto_1, Ponto2=Ponto_2)
# ---------- code_block.designscript (26 lines) ----------
Diedro;
LTE       = Diedro["LTerra"    ];
PPR       = Diedro["Diedro"    ];
Cuboides  = Diedro["Cuboides"  ];
Bisetores = Diedro["Bisetores" ];
//---------------------------------------------------------
P1        = Ponto1["Ponto"     ];
RAI1      = Ponto1["RaiosProj" ];
PRO1      = Ponto1["PontosProj"];
CHA1      = Ponto1["Chamadas"  ];
//---------------------------------------------------------
P2        = Ponto2["Ponto"     ];
RAI2      = Ponto2["RaiosProj" ];
PRO2      = Ponto2["PontosProj"];
CHA2      = Ponto2["Chamadas"  ];
//---------------------------------------------------------
Reta      = Line.ByStartPointEndPoint ( P1   , P2        );
Retaproj  = Line.ByStartPointEndPoint ( PRO1 , PRO2      );
Retasol   = Cylinder.ByPointsRadius   ( P1   , P2  , 0.25);
//---------------------------------------------------------
Epura     = [ PRO1[0], PRO2[0] , CHA1[0] , CHA2[0] , Retaproj[0], PPR[0], PPR[1]];
Ke        = ["Ponto1", "Ponto2", "Reta","RetaSol", "Projeções" ,  "Epura"];
Va        = [ P1     ,  P2,       Reta , Retasol ,  Retaproj   ,   Epura ];
Diedro;
Traçado = Dictionary.ByKeysValues(Ke, Va);
[LTE, PPR, P1, RAI1, PRO1, CHA1, P2, RAI2, PRO2, CHA2 , Reta, Retasol, Retaproj];
# ----------------------------------------
Reta = Output(code_block.out20)
Diedro_2 = Output(code_block.out19)  # "Diedro"
Elementos_Geométricos = Output(code_block.out21)
