# Dynamo graph SP_Rebatimento.dyn (Dynamo 2.3.0.5885)
# packages: Sistemas_Projetivos 1.0.0, Sistemas_Projetivos 1.1.0

parâmetro_de_rotaçao = DoubleSlider(0.575, range=0..1 step 0.005)  # graph input
qretas = DoubleSlider(25, range=1..25 step 1)  # graph input
tamanho_construção = DoubleSlider(3, range=1..25 step 1)  # graph input
deslocar = DoubleSlider(112, range=1..150 step 1)  # graph input
SP_Sistema_Diedrico = Custom[SP_Sistema_Diedrico](Escala=tamanho_construção, Deslocar=deslocar)  # package Sistemas_Projetivos; Cria os planos de projeção
abscissa = DoubleSlider(1.8, range=0..5 step 0.1)  # graph input
afastamento = DoubleSlider(2.8, range=0..5 step 0.1)  # graph input
cota = DoubleSlider(3.6, range=0..5 step 0.1)  # graph input
SP_Locar_Ponto = Custom[SP_Locar_Ponto](Diedro=SP_Sistema_Diedrico, abscissa=abscissa, Afastamento=afastamento, Cota=cota)  # package Sistemas_Projetivos; Localiza um ponto em Sistema Diedrico
abscissa_2 = DoubleSlider(0.4, range=0..5 step 0.1)  # graph input
afastamento_2 = DoubleSlider(2.8, range=0..5 step 0.1)  # graph input
cota_2 = DoubleSlider(2.5, range=0..5 step 0.1)  # graph input
SP_Locar_Ponto_2 = Custom[SP_Locar_Ponto](Diedro=SP_Sistema_Diedrico, abscissa=abscissa_2, Afastamento=afastamento_2, Cota=cota_2)
abscissa_3 = DoubleSlider(2.8, range=0..5 step 0.1)  # graph input
afastamento_3 = DoubleSlider(1.7, range=0..5 step 0.1)  # graph input
cota_3 = DoubleSlider(0.9, range=0..5 step 0.1)  # graph input
SP_Locar_Ponto_3 = Custom[SP_Locar_Ponto](Diedro=SP_Sistema_Diedrico, abscissa=abscissa_3, Afastamento=afastamento_3, Cota=cota_3)
SP_Locar_Plano = Custom[SP_Locar_Plano](P1=SP_Locar_Ponto.Ponto, P2=SP_Locar_Ponto_2.Ponto, P3=SP_Locar_Ponto_3.Ponto, Diedro=SP_Locar_Ponto_3.Diedro)  # package Sistemas_Projetivos; Posiciona um plano a partir de 3 pontos
SP_Rebatimento_01 = Custom[SP_Rebatimento_01](Angulo=parâmetro_de_rotaçao, Quantidade_de_Retas=qretas, Plano=SP_Locar_Plano.Plano, Diedro=SP_Locar_Plano.Diedro)  # package Sistemas_Projetivos; Faz rebatimento de um plano combinando Homologia Afim e Método dos triângulos
