# Dynamo custom node SP_Rotaciona_PPH.dyf (Dynamo 2.3.0.5885)
# category: Sistemas_Projetivos
# Rotaciona o plano de projeção Horizontal para formar a Epura 2D

Reta = Input(Reta: var[]..[])
Angulo = Input(Angulo: var[]..[])
code_block = CodeBlock(Reta_a=Reta, angulo=Angulo)
# ---------- code_block.designscript (34 lines) ----------
Reta_a;
lte = Reta_a["LTerra" ];
ret = Reta_a["Reta"   ];
sol = Reta_a["Solidos"];
pt1 = Reta_a["Ponto1" ]["Ponto"    ];
ra1 = Reta_a["Ponto1" ]["RaiosProj"];
pt2 = Reta_a["Ponto2" ]["Ponto"    ];
ra2 = Reta_a["Ponto2" ]["RaiosProj"];
//--------------------------------------------
//Elementos q rotacionam ---------------------
//--------------------------------------------
RetasProj = Reta_a["Projeções"];
PlanosPr1 = Reta_a["Ponto1"   ]["Planos"    ];
Chamadas1 = Reta_a["Ponto1"   ]["Chamadas"  ];
PontoPro1 = Reta_a["Ponto1"   ]["PontosProj"];
PlanosPr2 = Reta_a["Ponto2"   ]["Planos"    ];
Chamadas2 = Reta_a["Ponto2"   ]["Chamadas"  ];
PontoPro2 = Reta_a["Ponto2"   ]["PontosProj"];
angulo;
//--------------------------------------------
//Constantes----------------------------------
//--------------------------------------------
orig   = Point.ByCoordinates ( 0 , 0 , 0 );
eixo   = Vector.XAxis();
//--------------------------------------------
Epura3D = [ PontoPro1[0] , Chamadas1[0], PontoPro2[0] , Chamadas2[0], RetasProj[0]];
PlaPH3D =   PlanosPr1[0];
PHP2D   = PlaPH3D!=null?Geometry.Rotate( PlaPH3D , orig, eixo, angulo):null;
Epu2D   = Epura3D!=null?Geometry.Rotate( Epura3D , orig, eixo, angulo):null;
[ lte, pt1, pt2, ra1, ra2, sol, ret,
  RetasProj ,
  PlanosPr1 , Chamadas1, PontoPro1,
  PlanosPr2 , Chamadas2, PontoPro2,
  PHP2D     , Epu2D];
# ----------------------------------------
Resultado = Output(code_block.out22)
