# Dynamo custom node SP_Rotaciona_PPH_Plano.dyf (Dynamo 2.3.0.5885)
# category: Sistemas_Projetivos
# Rotaciona o PPH do traçado

Angulo = Input(Angulo: var[]..[])
Diedro = Input(Diedro: var[]..[])
Plano = Input(Plano: var[]..[])  # Se refere ao plano criado com a função SP_Locar_Plano
code_block = CodeBlock(angulo=Angulo, Diedro=Diedro, Plano=Plano)
# ---------- code_block.designscript (35 lines) ----------
angulo;
Diedro;
LTE = Diedro["LTerra"];
PPR = Diedro["Diedro"];
PTS = Plano["Pontos"];
ESF = Plano["Esferas"];
TRA = Plano["Traços"];
FIG = Plano["Figura"];
SUP = Plano["Superficie"];
RAI = Plano["Raios"];
CON = Plano["Contorno"];

PTR = List.Flatten(Plano["PtProjetado"], 3);
PRO = List.Flatten(Plano["Projeções"]  , 3);
CHA = List.Flatten(Plano["Chamadas"]   , 3);
//--------------------------------------------
//Constantes----------------------------------
//--------------------------------------------
orig   = Point.ByCoordinates ( 0 , 0 , 0 );
eixo   = Vector.XAxis();
//--------------------------------------------
Epura3D  = [  PPR[0], PPR[1] , PTR[0], PTR[2], PTR[4],
                               CHA[0], CHA[2], CHA[4],
                               PRO[0], PRO[1], PRO[2],
                               TRA[0][0] ];
Epura2D = Epura3D!=null?Geometry.Rotate( Epura3D , orig, eixo, angulo):null;

s     = [PTR[0]           , PTR[2]           , PTR[4]          ];
c     = [CHA[0].EndPoint  , CHA[2].EndPoint  , CHA[4].EndPoint ];
d     = [CHA[0].Direction , CHA[2].Direction , CHA[4].Direction];
a     = [angulo           , angulo           , angulo          ];
v     = [Vector.ZAxis()   , Vector.ZAxis()   , Vector.ZAxis()  ];
Arcos = Geometry.Rotate(Arc.ByCenterPointStartPointSweepAngle( c , s , a , v) , c,  d , [90, 90, 90]);

[PPR, LTE, PTS, ESF, TRA, FIG, SUP, RAI, CON, PTR, PRO, CHA, Epura3D, Epura2D, Arcos];
# ----------------------------------------
Resultado = Output(code_block.out24)
