# Dynamo custom node SP_Rotaciona_PPH_Ponto.dyf (Dynamo 2.3.0.5885)
# category: Sistemas_Projetivos
# Rotaciona o PPH do traçado

Ponto = Input(Ponto: var[]..[])
Diedro = Input(Diedro: var[]..[])
Angulo = Input(Angulo: var[]..[])
code_block = CodeBlock(Ponto=Ponto, Diedro=Diedro, angulo=Angulo)
# ---------- code_block.designscript (20 lines) ----------
Ponto;
Diedro;
angulo;
//------------------------------------------
//Constantes--------------------------------
orig = Point.ByCoordinates ( 0 , 0 , 0);
eixo = Vector.XAxis();
//------------------------------------------
LTE  = Diedro["LTerra"    ];
PPH  = Diedro["Diedro"    ];
PTO  = Ponto ["Ponto"     ];
PRO  = Ponto ["PontosProj"];
RAI  = Ponto ["RaiosProj" ];
CHA  = Ponto ["Chamadas"  ];
//Rotaciona PPH-----------------------------

Epura3D = [ PRO[0] , CHA[0] , PPH[0],  PPH[1]];
Epura2D = Epura3D!=null?Geometry.Rotate( Epura3D , orig, eixo, angulo):null;
Diedro;
[LTE, PPH, PTO, PRO, RAI, CHA];
# ----------------------------------------
Diedro_2 = Output(code_block.out13)  # "Diedro"
Traçado = Output(code_block.out14)
Resultado = Output(code_block.out12)
