# Dynamo custom node SP_Rotaciona_PPH_Reta.dyf (Dynamo 2.3.0.5885)
# category: Sistemas_Projetivos
# Rotaciona o PPH do traçado

Diedro = Input(Diedro: var[]..[])
Reta = Input(Reta: var[]..[])
Angulo = Input(Angulo: var[]..[])
code_block = CodeBlock(Diedro=Diedro, Reta=Reta, angulo=Angulo)
# ---------- code_block.designscript (30 lines) ----------
Diedro;
Reta;
angulo;
LTE   = Diedro["LTerra"];
PPH   = Diedro["Diedro"];
ret1  = Reta  ["Reta"  ];
sol1  = Reta  ["RetaSol"];
PTO1  = Reta  ["Ponto1" ]["Ponto"    ];
PTO2  = Reta  ["Ponto2" ]["Ponto"    ];
RAI1  = Reta  ["Ponto1" ]["RaiosProj"];
RAI2  = Reta  ["Ponto2" ]["RaiosProj"];
//--------------------------------------------
//Elementos q rotacionam ---------------------
//--------------------------------------------
RPro  = Reta  ["Projeções"];
PPro1 = Reta  ["Ponto1"   ]["PontosProj"];
PPro2 = Reta  ["Ponto2"   ]["PontosProj"];
Cham1 = Reta  ["Ponto1"   ]["Chamadas"  ];
Cham2 = Reta  ["Ponto2"   ]["Chamadas"  ];
Epura = Reta  ["Epura"];
//--------------------------------------------
//Constantes----------------------------------
//--------------------------------------------
orig   = Point.ByCoordinates ( 0 , 0 , 0 );
eixo   = Vector.XAxis();
//--------------------------------------------
Epura3D  = List.Flatten([ PPH[0], Epura], 3);
Epura2D  = Epura3D!=null?Geometry.Rotate( Epura3D , orig, eixo, angulo):null;
Epura2D;
Diedro;
# ----------------------------------------
Resultado = Output(code_block.out21)
Diedro_2 = Output(code_block.out22)  # "Diedro"
